# Grasshopper definition voronoi_corridor.gh (Grasshopper 1.0.8)

R = Region({Plane=PlaneXY(142.3230128, 52.47345201, 0), Size=Domain2(u=-2068.383196..2068.383196, v=-1300.574282..1300.574282)})
box = CenterBox(Base=PlaneXY(0, 0, 0), X=1000, Y=1000, Z=1000)
brep = Brep(<brep referenced from the Rhino model>)
sph = Sphere(Base=PlaneXY(0, 0, 0), Radius=1000)
pop2d = Populate2D(Region=R, Count=100, Seed=1)
pop3d = Populate3D(Region=box, Count=100, Seed=1)
popgeo = PopulateGeometry(Geometry=brep, Count=50, Seed=1)
voronoi³ = Voronoi3D(Points=popgeo)  # -> Cells, Boundary
debrep = DeconstructBrep(Brep=voronoi³.Cells)  # -> Faces, Edges, Vertices
srfsplit = SurfaceSplit(Surface=brep, Curves=debrep.Edges)
area = Area(Geometry=srfsplit)  # -> Area, Centroid
scale = Scale(Geometry=srfsplit, Center=area.Centroid, Factor=0.8)  # -> Geometry, Transform
edges = BrepEdges(Brep=simplify(scale.Geometry))  # -> Naked, Interior, NonManifold
join = JoinCurves(Curves=edges.Naked, Preserve=False)
volume = Volume(Geometry=brep)  # -> Volume, Centroid
srfsplit_2 = SurfaceSplit(Surface=brep, Curves=join)
area_2 = Area(Geometry=brep)  # -> Area, Centroid
item = ListItem(List=srfsplit_2, Index=0, Wrap=True)
offset = OffsetSurface(Surface=brep, Distance=-10, Retrim=True)
extr = ExtrudePoint(Base=item, Point=area_2.Centroid)
trim = TrimSolid(Shape=extr, Cutters=offset)
sdiff = SolidDifference(BrepsA=extr, BrepsB=offset)
